vi "index.gviweb"   [LabVIEW NXG 5.0.0]
panel controls:
  "நாழிகை : கணம்": i32
  "திருவள்ளுவர் ஆண்டு : நாள்": i32
  "Next": string = "எண்முறை.html"
  "நிமையம் : நொடி": i32
  "Next_2": string = "தகவல்.html"
  "முன்": bool
  "அடுத்தது": bool
  "மொழி": T2 = "முத்தமிழ்"
  "அடுத்த குறள்": T3 = "நிமையம்"
  "சிறுபொழுது": i32
panel indicators:
  "கணங்கள்": u8
  "நாழிகைகள்": u8
  "நாழிகை": u8
  "நிமையம்": u8
  "நொடி": i32
  "நிமையங்கள்": u8
  "கிழமை": i32
  "ஆண்டுநாள்": u16
  "ஆண்டு": u32
  "பருவம் >> மாதம் : நாட்கள்": cluster{"location": string, "data": string}[]
  "கணம்": u8
  "நொடிகள்": u8
  "திருக்குறள்": string
  "மாதநாள்": i32
  "பொழுதுகள்": u8
  "பொழுது": T1
  "மாதநாள்_2": i16
  "ஆண்டுநாள்கள்": u8
  "குறள் எண்": u16
  "திருவள்ளுவர் ஆண்டு": i32
  "பால்": enum{"அறம்", "பொருள்", "இன்பம்"}
  "இயல்": T4
  "அதிகாரம்": T5
  "மாதம்": T6
types:
  T1 = enum{"யாமம்", "வைகறை", "காலை", "நண்பகல்", "எற்பாடு", "மாலை"}
  T2 = enum{"முத்தமிழ்", "ஆங்கிலம் (English)", "தெலுங்கு (తెలుగు)", "மலையாளம் (മലയാളം)", "கன்னடம் (ಕನ್ನಡ)", "சீனம் (汉语)", "மலாய் (Melayu)", "கொரிய (한국어)", "உருசிய (Русский)", "அரபு (العَرَبِيَّة)", "பிரெஞ்சு (Français)", "செர்மன் (Deutsch)", "சுவீடிய (Svenska)", "இலத்தீன் (Latīna)", "போலிய (Polski)"}
  T3 = enum{"நிமையம்", "கணம்", "நாழிகை", "பொழுது", "நாள்"}
  T4 = enum{"பாயிரவியல்", "இல்லறவியல்", "துறவறவியல்", "ஊழியல் ", "அரசியல்", "அமைச்சியல்", "அரணியல்", "கூழியல்", "படையில்", "நட்பியல்", "குடியியல்", "களவியல்", "கற்பியல்"}
  T5 = enum{"கடவுள் வாழ்த்து", "வான்சிறப்பு", "நீத்தார் பெருமை", "அறன்வலியுறுத்தல்", "இல்வாழ்க்கை", "வாழ்க்கைத் துணைநலம்", "மக்கட்பேறு", "அன்புடைமை", "விருந்தோம்பல்", "இனியவைகூறல்", "செய்ந்நன்றி அறிதல்", "நடுவு நிலைமை", "அடக்கமுடைமை", "ஒழுக்கமுடைமை", "பிறனில் விழையாமை", "பொறையுடைமை", "அழுக்காறாமை", "வெஃகாமை", "புறங்கூறாமை", "பயனில சொல்லாமை", "தீவினையச்சம்", "ஒப்புரவறிதல்", "ஈகை", "புகழ்", "அருளுடைமை", "புலான்மறுத்தல்", "தவம்", "கூடாவொழுக்கம்", "கள்ளாமை", "வாய்மை", "வெகுளாமை", "இன்னாசெய்யாமை", "கொல்லாமை", "நிலையாமை", "துறவு", "மெய்யுணர்தல்", "அவாவறுத்தல்", "ஊழ்", "இறைமாட்சி", "கல்வி", "கல்லாமை", "கேள்வி", "அறிவுடைமை", "குற்றங்கடிதல்", "பெரியாரைத் துணைக்கோடல்", "சிற்றினஞ்சேராமை", "தெரிந்துசெயல்வகை", "வலியறிதல்", "காலமறிதல்", "இடனறிதல்", "தெரிந்துதெளிதல்", "தெரிந்துவினையாடல்", "சுற்றந்தழால்", "பொச்சாவாமை", "செங்கோன்மை", "கொடுங்கோன்மை", "வெருவந்தசெய்யாமை", "கண்ணோட்டம்", "ஒற்றாடல்", "ஊக்கமுடைமை"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}
  T6 = enum{"மார்கழி", "தை", "மாசி", "பங்குனி", "சித்திரை", "வைகாசி", "ஆனி", "ஆடி", "ஆவணி", "புரட்டாசி", "ஐப்பசி", "கார்த்திகை"}
uses:
  வலை::குறள்தொடக்கம்.gviweb
  வலை::குறள்படி.gviweb
  வலை::நேரமாற்றம்.gviweb
  வலை::தேதிமாற்றம்.gviweb
diagram:
  call "குறள்தொடக்கம்.gviweb"(கணம்?=FALSE) -> (தொடக்கம்=w1)
  s1 = w1  # shift register
  s2 = TRUE  # shift register
  s3 = uninitialised  # shift register
  s4 = uninitialised  # shift register
  s5 = uninitialised  # shift register
  while {
    case (s2) {
      frame False, Default {
        w2 = s1
        w3 = s3
        w4 = s4
        w5 = s5
      }
      frame True {
        call "குறள்படி.gviweb"(அடைவு=s1) -> (குறள் எண்=w2, திருக்குறள்=w4, பொருள்=w3, தகவல்=w5)
      }
    }
    Get Current Time() -> (current time=w6)
    Timestamp To Date And Time(time stamp=w6) -> (date time rec=w7)
    Property Node(instance in=w7) -> ("second"=w8)
    Is Equal To 0(x=w8) -> w9
    Is First Call() -> w10
    Logical Or(w9, w10) -> w11
    case (w11) {
      frame False {
        Logical Or($"அடுத்தது", $"முன்") -> w13
        case ($"முன்") {
          frame False, Default {
            w12 = w2
          }
          frame True {
            Subtract(x=w2, y=2) -> w12
          }
        }
        $"குறள் எண்" <- w2
        Array Index(array=w3) -> (out0[$"மொழி"]=w17)
        Concatenate Strings(w4, "\r\n", w17) -> w18
        $"திருக்குறள்" <- w18
        Property Node(instance in=w5) -> ("பால்"=w19, "இயல்"=w20, "அதிகாரம்"=w21)
        $"பால்" <- w19
        $"இயல்" <- w20
        $"அதிகாரம்" <- w21
        w14 = w3
        w15 = w4
        w16 = w5
      }
      frame True {
        call "நேரமாற்றம்.gviweb"(அடுத்த குறள்=$"அடுத்த குறள்") -> (அடுத்தது?=w13, சிறுபொழுது=w22, நாழிகை=w23, கணம்=w24, நிமிடம்=w25, கிழமை=w26)
        $"கிழமை" <- w26
        $"பொழுதுகள்" <- w22
        $"பொழுது" <- w22
        $"நாழிகை" <- w23
        $"நாழிகைகள்" <- w23
        $"கணங்கள்" <- w24
        $"கணம்" <- w24
        $"நிமையங்கள்" <- w25
        $"நிமையம்" <- w25
        Is First Call() -> w27
        Logical Or(w13, w27) -> w28
        case (w28) {
          frame False { }
          frame True {
            w29 = ["முன்பனி\\மார்கழி", "முன்பனி\\தை", "பின்பனி\\மாசி", "பின்பனி\\பங்குனி", "இளவேனில்\\சித்திரை", "இளவேனில்\\வைகாசி", "முதுவேனில்\\ஆனி", "முதுவேனில்\\ஆடி", "கார்\\ஆவணி", "கார்\\புரட்டாசி", "கூதிர்\\ஐப்பசி", "கூதிர்\\கார்த்திகை"]
            call "தேதிமாற்றம்.gviweb"() -> (ஆண்டு=w30, நாள்=w31, மாதம்=w32, மாதநாள்=w33)
            Array Index(array=w29) -> (out0[w32]=w34)
            Property Node(instance in=reference to "பருவம் >> மாதம் : நாட்கள்", "Selection"=w34)
            $"திருவள்ளுவர் ஆண்டு" <- w30
            $"ஆண்டு" <- w30
            $"ஆண்டுநாள்கள்" <- w31
            $"ஆண்டுநாள்" <- w31
            $"மாதம்" <- w32
            $"மாதநாள்_2" <- w33
            $"மாதநாள்" <- w33
          }
        }
        w12 = w2
        w14 = w3
        w15 = w4
        w16 = w5
      }
    }
    $"நொடி" <- w8
    $"நொடிகள்" <- w8
    # நிமிடம்     = 60 நொடிகள்
    # கணம்      = 4 நிமிடங்கள்
    # நாழிகை   = 6 கணங்கள்
    # பொழுது   = 10 நாழிகைகள்
    # நாள்         = 6 பொழுதுகள்
    Wait Until Next Multiple(multiple to wait=1000)
    next s1 = w12
    next s2 = w13
    next s3 = w14
    next s4 = w15
    next s5 = w16
    stop if FALSE
  }
  w35 = [{"location"="முன்பனி\\மார்கழி", "data"="29.35"}, {"location"="முன்பனி\\தை", "data"="29.45"}, {"location"="பின்பனி\\மாசி", "data"="29.8"}, {"location"="பின்பனி\\பங்குனி", "data"="30.35"}, {"location"="இளவேனில்\\சித்திரை", "data"="30.92"}, {"location"="இளவேனில்\\வைகாசி", "data"="31.4"}, {"location"="முதுவேனில்\\ஆனி", "data"="31.61"}, {"location"="முதுவேனில்\\ஆடி", "data"="30.47"}, {"location"="கார்\\ஆவணி", "data"="32.03"}, {"location"="கார்\\புரட்டாசி", "data"="30.47"}, {"location"="கூதிர்\\ஐப்பசி", "data"="29.9"}, {"location"="கூதிர்\\கார்த்திகை", "data"="29.5"}]
  $"பருவம் >> மாதம் : நாட்கள்" <- w35
