vi "எண்முறை.gviweb"   [LabVIEW NXG 5.0.0]
panel controls:
  "Next": string = "index.html"
  "Next_2": string = "தகவல்.html"
  "முன்": bool
  "அடுத்தது": bool
  "மொழி": T5 = "முத்தமிழ்"
  "அடுத்த குறள்": T6 = "நிமையம்"
panel indicators:
  "பொழுது": T1
  "நாழிகை": u8
  "நிமையம்": u8
  "நொடி": i32
  "கிழமை": T2
  "நாள்": u16
  "ஆண்டு": u32
  "திங்கள்": T3
  "பருவம்": T4
  "மாதநாள்": u8
  "கணம்": u8
  "குறள் எண்": u16
  "திருக்குறள்": string
  "பால்": enum{"அறம்", "பொருள்", "இன்பம்"}
  "அதிகாரம்": T7
  "இயல்": T8
types:
  T1 = enum{"யாமம்", "வைகறை", "காலை", "நண்பகல்", "எற்பாடு", "மாலை"}
  T2 = enum{"ஞாயிறு", "திங்கள்", "செவ்வாய்", "அறிவன்", "வியாழன்", "வெள்ளி", "காரி"}
  T3 = enum{"மார்கழி", "தை", "மாசி", "பங்குனி", "சித்திரை", "வைகாசி", "ஆனி", "ஆடி", "ஆவணி", "புரட்டாசி", "ஐப்பசி", "கார்த்திகை"}
  T4 = enum{"முன்பனி", "பின்பனி ", "இளவேனில்", "முதுவேனில்", "கார்", "கூதிர்"}
  T5 = enum{"முத்தமிழ்", "ஆங்கிலம் (English)", "தெலுங்கு (తెలుగు)", "மலையாளம் (മലയാളം)", "கன்னடம் (ಕನ್ನಡ)", "சீனம் (汉语)", "மலாய் (Melayu)", "கொரிய (한국어)", "உருசிய (Русский)", "அரபு (العَرَبِيَّة)", "பிரெஞ்சு (Français)", "செர்மன் (Deutsch)", "சுவீடிய (Svenska)", "இலத்தீன் (Latīna)", "போலிய (Polski)"}
  T6 = enum{"நிமையம்", "கணம்", "நாழிகை", "பொழுது", "நாள்"}
  T7 = enum{"கடவுள் வாழ்த்து", "வான்சிறப்பு", "நீத்தார் பெருமை", "அறன்வலியுறுத்தல்", "இல்வாழ்க்கை", "வாழ்க்கைத் துணைநலம்", "மக்கட்பேறு", "அன்புடைமை", "விருந்தோம்பல்", "இனியவைகூறல்", "செய்ந்நன்றி அறிதல்", "நடுவு நிலைமை", "அடக்கமுடைமை", "ஒழுக்கமுடைமை", "பிறனில் விழையாமை", "பொறையுடைமை", "அழுக்காறாமை", "வெஃகாமை", "புறங்கூறாமை", "பயனில சொல்லாமை", "தீவினையச்சம்", "ஒப்புரவறிதல்", "ஈகை", "புகழ்", "அருளுடைமை", "புலான்மறுத்தல்", "தவம்", "கூடாவொழுக்கம்", "கள்ளாமை", "வாய்மை", "வெகுளாமை", "இன்னாசெய்யாமை", "கொல்லாமை", "நிலையாமை", "துறவு", "மெய்யுணர்தல்", "அவாவறுத்தல்", "ஊழ்", "இறைமாட்சி", "கல்வி", "கல்லாமை", "கேள்வி", "அறிவுடைமை", "குற்றங்கடிதல்", "பெரியாரைத் துணைக்கோடல்", "சிற்றினஞ்சேராமை", "தெரிந்துசெயல்வகை", "வலியறிதல்", "காலமறிதல்", "இடனறிதல்", "தெரிந்துதெளிதல்", "தெரிந்துவினையாடல்", "சுற்றந்தழால்", "பொச்சாவாமை", "செங்கோன்மை", "கொடுங்கோன்மை", "வெருவந்தசெய்யாமை", "கண்ணோட்டம்", "ஒற்றாடல்", "ஊக்கமுடைமை"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}
  T8 = enum{"பாயிரவியல்", "இல்லறவியல்", "துறவறவியல்", "ஊழியல் ", "அரசியல்", "அமைச்சியல்", "அரணியல்", "கூழியல்", "படையில்", "நட்பியல்", "குடியியல்", "களவியல்", "கற்பியல்"}
uses:
  வலை::குறள்தொடக்கம்.gviweb
  வலை::குறள்படி.gviweb
  வலை::நேரமாற்றம்.gviweb
  வலை::தேதிமாற்றம்.gviweb
diagram:
  call "குறள்தொடக்கம்.gviweb"(கணம்?=FALSE) -> (தொடக்கம்=w1)
  s1 = w1  # shift register
  s2 = TRUE  # shift register
  s3 = uninitialised  # shift register
  s4 = uninitialised  # shift register
  s5 = uninitialised  # shift register
  while {
    case (s2) {
      frame False, Default {
        w2 = s1
        w3 = s3
        w4 = s4
        w5 = s5
      }
      frame True {
        call "குறள்படி.gviweb"(அடைவு=s1) -> (குறள் எண்=w2, திருக்குறள்=w4, பொருள்=w3, தகவல்=w5)
      }
    }
    Get Current Time() -> (current time=w6)
    Timestamp To Date And Time(time stamp=w6) -> (date time rec=w7)
    Property Node(instance in=w7) -> ("second"=w8)
    Is Equal To 0(x=w8) -> w9
    Is First Call() -> w10
    Logical Or(w9, w10) -> w11
    case (w11) {
      frame False {
        Logical Or($"அடுத்தது", $"முன்") -> w12
        case ($"முன்") {
          frame False, Default {
            w13 = w2
          }
          frame True {
            Subtract(x=w2, y=2) -> w13
          }
        }
        $"குறள் எண்" <- w2
        Array Index(array=w3) -> (out0[$"மொழி"]=w17)
        Concatenate Strings(w4, "\r\n", w17) -> w18
        $"திருக்குறள்" <- w18
        Property Node(instance in=w5) -> ("பால்"=w19, "இயல்"=w20, "அதிகாரம்"=w21)
        $"பால்" <- w19
        $"இயல்" <- w20
        $"அதிகாரம்" <- w21
        w14 = w3
        w15 = w4
        w16 = w5
      }
      frame True {
        call "நேரமாற்றம்.gviweb"(அடுத்த குறள்=$"அடுத்த குறள்") -> (அடுத்தது?=w12, சிறுபொழுது=w22, நாழிகை=w23, கணம்=w24, நிமிடம்=w25, கிழமை=w26)
        $"கிழமை" <- w26
        $"பொழுது" <- w22
        $"நாழிகை" <- w23
        $"கணம்" <- w24
        $"நிமையம்" <- w25
        Is First Call() -> w27
        Logical Or(w12, w27) -> w28
        case (w28) {
          frame False { }
          frame True {
            call "தேதிமாற்றம்.gviweb"() -> (பருவம்=w29, ஆண்டு=w30, நாள்=w31, மாதம்=w32, மாதநாள்=w33)
            $"ஆண்டு" <- w30
            $"நாள்" <- w31
            $"திங்கள்" <- w32
            $"மாதநாள்" <- w33
            $"பருவம்" <- w29
          }
        }
        w13 = w2
        w14 = w3
        w15 = w4
        w16 = w5
      }
    }
    Wait Until Next Multiple(multiple to wait=1000)
    $"நொடி" <- w8
    next s1 = w13
    next s2 = w12
    next s3 = w14
    next s4 = w15
    next s5 = w16
    stop if FALSE
  }
