vi "குறளிசை.gviweb"   [LabVIEW NXG 5.0.0]
inputs:
  "தொடக்கம்": u16
outputs:
  "Kural": string
  "error out": error
uses:
  Library::குறளிசை.jsli::PlayAudio
diagram:
  case ($"தொடக்கம்") {
    frame 1..380, Default {
      w1 = "அறம்"
    }
    frame 381..1080 {
      w1 = "பொருள்"
    }
    frame 1081..1330 {
      w1 = "இன்பம்"
    }
  }
  Format Into String(formatString="%s/kural-%04d.mp3", initString="குறளிசை/", w1, $"தொடக்கம்") -> w2
  call "PlayAudio"(X=w2) -> (Z=w3, error out=w4)
  $Kural <- w3
  $"error out" <- w4
