vi "குறள்தொடக்கம்.gviweb"   [LabVIEW NXG 5.0.0]
inputs:
  "கணம்?": bool
outputs:
  "தொடக்கம்": u16
diagram:
  Get Current Time() -> (current time=w1)
  Timestamp To Date And Time(time stamp=w1) -> (date time rec=w2)
  Property Node(instance in=w2) -> ("year"=w3, "day of year"=w4, "hour"=w5, "minute"=w6)
  case ($"கணம்?") {
    frame False, Default {
      case (w5) {
        frame ..3 {
          Add(w5, 24) -> w8
        }
        frame Default {
          w8 = w5
        }
      }
      Subtract(x=w8, y=4) -> w9
      Multiply(w9, 60) -> w10
      Add(w10, w6) -> w7
    }
    frame True {
      Quotient And Remainder(x=w6, y=4) -> (floor(x/y)=w11)
      Multiply(w5, 15) -> w12
      Quotient And Remainder(x=w4, y=133) -> (x-y*floor(x/y)=w13)
      Multiply(36, w13) -> w14
      Quotient And Remainder(x=w3, y=133) -> (x-y*floor(x/y)=w15)
      Multiply(115, w15) -> w16
      Quotient And Remainder(x=w16, y=133) -> (x-y*floor(x/y)=w17)
      Add(w17, w14) -> w18
      Multiply(w18, 10) -> w19
      Add(w19, w12, w11) -> w7
    }
  }
  Quotient And Remainder(x=w7, y=1330) -> (x-y*floor(x/y)=w20)
  $"தொடக்கம்" <- w20
