vi "தகவல்.gviweb"   [LabVIEW NXG 5.0.0]
panel controls:
  "நேரம்": i32 = 2
  "காலம்": i32 = 2
  "Next": string = "index.html"
  "அடுத்த குறள்": T6 = "நிமையம்"
  "அடுத்தது": bool
  "முன்": bool
  "மொழி": T7 = "முத்தமிழ்"
panel indicators:
  "கணங்கள்": u8
  "பொழுது": T1
  "நாழிகைகள்": u8
  "நாழிகை": u8
  "நிமையம்": u8
  "நொடி": u8
  "சிறுபொழுது": u8
  "நிமையங்கள்": u8
  "கிழமை": T2
  "நாள்": u16
  "ஆண்டு": u32
  "மாதம்": T3
  "பருவம்": T4
  "மாதங்கள்": u8
  "பருவங்கள்": u8
  "கிழமைகள்": u8
  "மாதநாள்": u8
  "நாட்கள்": u16
  "கணம்": u8
  "நொடிகள்": u8
  "மாதநாள்கள்": u8
  "பருவம் >> மாதம் : நாட்கள்": T5[]
  "குறள் எண்": u16
  "திருக்குறள்": string
types:
  T1 = enum{"யாமம்", "வைகறை", "காலை", "நண்பகல்", "எற்பாடு", "மாலை"}
  T2 = enum{"ஞாயிறு", "திங்கள்", "செவ்வாய்", "அறிவன்", "வியாழன்", "வெள்ளி", "காரி"}
  T3 = enum{"மார்கழி", "தை", "மாசி", "பங்குனி", "சித்திரை", "வைகாசி", "ஆனி", "ஆடி", "ஆவணி", "புரட்டாசி", "ஐப்பசி", "கார்த்திகை"}
  T4 = enum{"முன்பனி", "பின்பனி ", "இளவேனில்", "முதுவேனில்", "கார்", "கூதிர்"}
  T5 = cluster{"பருவம்": string, "மாதம்": string, "நாட்கள்": f64}
  T6 = enum{"நிமையம்", "கணம்", "நாழிகை", "பொழுது", "நாள்"}
  T7 = enum{"முத்தமிழ்", "ஆங்கிலம் (English)", "தெலுங்கு (తెలుగు)", "மலையாளம் (മലയാളം)", "கன்னடம் (ಕನ್ನಡ)", "சீனம் (汉语)", "மலாய் (Melayu)", "கொரிய (한국어)", "உருசிய (Русский)", "அரபு (العَرَبِيَّة)", "பிரெஞ்சு (Français)", "செர்மன் (Deutsch)", "சுவீடிய (Svenska)", "இலத்தீன் (Latīna)", "போலிய (Polski)"}
uses:
  வலை::குறள்தொடக்கம்.gviweb
  வலை::குறள்படி.gviweb
  வலை::நேரமாற்றம்.gviweb
  வலை::தேதிமாற்றம்.gviweb
diagram:
  call "குறள்தொடக்கம்.gviweb"(கணம்?=FALSE) -> (தொடக்கம்=w1)
  s1 = TRUE  # shift register
  s2 = w1  # shift register
  s3 = uninitialised  # shift register
  s4 = uninitialised  # shift register
  while {
    case (s1) {
      frame False, Default {
        w2 = s2
        w3 = s4
        w4 = s3
      }
      frame True {
        call "குறள்படி.gviweb"(அடைவு=s2) -> (குறள் எண்=w2, திருக்குறள்=w4, பொருள்=w3)
      }
    }
    Get Current Time() -> (current time=w5)
    Timestamp To Double Precision Float(number=w5) -> (double precision float=w6)
    Quotient And Remainder(x=w6, y=60) -> (x-y*floor(x/y)=w7)
    To Unsigned 8 Bit Integer(number=w7) -> w8
    Is Equal To 0(x=w8) -> w9
    Is First Call() -> w10
    Logical Or(w9, w10) -> w11
    case (w11) {
      frame False {
        Logical Or($"அடுத்தது", $"முன்") -> w15
        case ($"முன்") {
          frame False, Default {
            w14 = w2
          }
          frame True {
            Subtract(x=w2, y=2) -> w14
          }
        }
        Array Index(array=w3) -> (out0[$"மொழி"]=w16)
        Concatenate Strings(w4, "\r\n", w16) -> w17
        $"திருக்குறள்" <- w17
        $"குறள் எண்" <- w2
        w12 = w4
        w13 = w3
      }
      frame True {
        call "நேரமாற்றம்.gviweb"(அடுத்த குறள்=$"அடுத்த குறள்") -> (அடுத்தது?=w15, சிறுபொழுது=w18, நாழிகை=w19, கணம்=w20, நிமிடம்=w21, கிழமை=w22)
        $"கிழமைகள்" <- w22
        $"கிழமை" <- w22
        $"சிறுபொழுது" <- w18
        $"பொழுது" <- w18
        $"நாழிகை" <- w19
        $"நாழிகைகள்" <- w19
        $"கணங்கள்" <- w20
        $"கணம்" <- w20
        $"நிமையங்கள்" <- w21
        $"நிமையம்" <- w21
        Is First Call() -> w23
        Logical Or(w15, w23) -> w24
        case (w24) {
          frame False { }
          frame True {
            call "தேதிமாற்றம்.gviweb"() -> (பருவம்=w25, ஆண்டு=w26, நாள்=w27, மாதம்=w28, மாதநாள்=w29)
            $"ஆண்டு" <- w26
            $"நாள்" <- w27
            $"நாட்கள்" <- w27
            $"மாதங்கள்" <- w28
            $"மாதம்" <- w28
            $"மாதநாள்" <- w29
            $"மாதநாள்கள்" <- w29
            $"பருவங்கள்" <- w25
            $"பருவம்" <- w25
          }
        }
        w12 = w4
        w13 = w3
        w14 = w2
      }
    }
    Wait Until Next Multiple(multiple to wait=1000)
    $"நொடி" <- w8
    $"நொடிகள்" <- w8
    next s1 = w15
    next s2 = w14
    next s3 = w12
    next s4 = w13
    stop if FALSE
  }
  w30 = [{"பருவம்"="முன்பனி", "மாதம்"="மார்கழி", "நாட்கள்"=29.35}, {"பருவம்"="", "மாதம்"="தை", "நாட்கள்"=29.45}, {"பருவம்"="பின்பனி", "மாதம்"="மாசி", "நாட்கள்"=29.8}, {"பருவம்"="", "மாதம்"="பங்குனி", "நாட்கள்"=30.35}, {"பருவம்"="இளவேனில்", "மாதம்"="சித்திரை", "நாட்கள்"=30.92}, {"பருவம்"="", "மாதம்"="வைகாசி", "நாட்கள்"=31.4}, {"பருவம்"="முதுவேனில்", "மாதம்"="ஆனி", "நாட்கள்"=31.61}, {"பருவம்"="", "மாதம்"="ஆடி", "நாட்கள்"=30.47}, {"பருவம்"="கார்", "மாதம்"="ஆவணி", "நாட்கள்"=32.03}, {"பருவம்"="", "மாதம்"="புரட்டாசி", "நாட்கள்"=30.47}, {"பருவம்"="கூதிர்", "மாதம்"="ஐப்பசி", "நாட்கள்"=29.9}, {"பருவம்"="", "மாதம்"="கார்த்திகை", "நாட்கள்"=29.5}]
  $"பருவம் >> மாதம் : நாட்கள்" <- w30
