vi "தேதிமாற்றம்.gviweb"   [LabVIEW NXG 5.0.0]
outputs:
  "நாள்": i32
  "ஆண்டு": u32
  "மாதநாள்": i16
  "மாதம்": T2
  "பருவம்": T1
types:
  T1 = enum{"முன்பனி", "பின்பனி ", "இளவேனில்", "முதுவேனில்", "கார்", "கூதிர்"}
  T2 = enum{"மார்கழி", "தை", "மாசி", "பங்குனி", "சித்திரை", "வைகாசி", "ஆனி", "ஆடி", "ஆவணி", "புரட்டாசி", "ஐப்பசி", "கார்த்திகை"}
diagram:
  Get Current Time() -> (current time=w1)
  Timestamp To Date And Time(time stamp=w1) -> (date time rec=w2)
  Property Node(instance in=w2) -> ("day of year"=w3, "year"=w4)
  Add(w4, 31) -> w5
  Quotient And Remainder(x=w5, y=4) -> (x-y*floor(x/y)=w6)
  case (w6) {
    frame 0, Default {
      w7 = 365
      w8 = 0
      w9 = 1
    }
    frame 1 {
      w7 = 366
      w8 = 25
      w9 = default
    }
    frame 2 {
      w7 = 365
      w8 = 50
      w9 = default
    }
    frame 3 {
      w7 = 365
      w8 = 75
      w9 = default
    }
  }
  Subtract(x=w3, y=13) -> w10
  Subtract(x=w10, y=w9) -> w11
  Is Less Or Equal To 0(x=w11) -> w12
  case (w12) {
    frame True {
      Add(w11, w7) -> w14
      Subtract(x=w8, y=25) -> w16
      case (w16) {
        frame 0, Default {
          w15 = w16
        }
        frame ..-1 {
          w15 = 75
        }
      }
      Decrement(x=w5) -> w13
    }
    frame False {
      w13 = w5
      w14 = w11
      w15 = w8
    }
  }
  $"நாள்" <- w14
  w17 = [0, 29.45018519, 59.25046296, 89.60001157, 120.5170486, 151.9171875, 183.5335995, 215.0004051, 246.0338542, 276.500081, 306.400162, 335.9004398, 365.2503588, 700]
  Divide(x=w15, y=100) -> w18
  Add(w18, w17) -> w19
  Round To Nearest(number=w19) -> w20
  To Signed 16 Bit Integer(number=w20) -> w21
  Threshold 1D Array(array of numbers or points=w21, threshold y=w14) -> w22
  Round Toward Positive Infinity(x=w22) -> w23
  Decrement(x=w23) -> w24
  To Signed 32 Bit Integer(number=w24) -> w25
  Increment(x=w25) -> w26
  Quotient And Remainder(x=w26, y=12) -> (x-y*floor(x/y)=w27)
  $"மாதம்" <- w27
  Quotient And Remainder(x=w27, y=2) -> (floor(x/y)=w28)
  $"பருவம்" <- w28
  Array Index(array=w21) -> (out0[w25]=w29)
  Subtract(x=w14, y=w29) -> w30
  $"மாதநாள்" <- w30
  $"ஆண்டு" <- w13
